# Grasshopper definition growing_algorithms.gh (Grasshopper 1.0.7)
# plug-ins: Kangaroo2 Components

number_slider = Slider(7, range=0..10)
num = Number([-1, 0, 1])
num_2 = Number([0, -4, 0, 2, 2])
merge = Merge(
    Data1=Slider(-5, range=-5..5),
    Data2=Slider(0.5, range=-5..5),
    Data3=Slider(0.5, range=-5..5),
    Data4=Slider(0.5, range=-5..5),
    Data5=Slider(0.5, range=-5..5),
    Data6=Slider(0.5, range=-5..5),
    Data7=Slider(0.5, range=-5..5),
    Data8=Slider(0.5, range=-5..5),
    Data9=Slider(0.5, range=-5..5),
    Data10=Slider(0.5, range=-5..5))
merge_2 = Merge(Data1=Slider(-5, range=-5..5), Data3=Slider(2, range=-5..5), Data4=Slider(2, range=-5..5))
lng = ListLength(List=merge)
ma = MassAddition(Input=merge)  # -> Result, PartialResults
dom = ConstructDomain(DomainStart=0, DomainEnd=Slider(7, range=0..10))
num_3 = Number(merge_2)
pt = Point()
lng_2 = ListLength(List=merge_2)
ma_2 = MassAddition(Input=merge_2)  # -> Result, PartialResults
random = Random(Range=dom, Number=Slider(50, range=0..10000), Seed=2)
division = Division(A=ma.Result, B=lng)
pt_2 = ConstructPoint(XCoordinate=num_3, YCoordinate=graft(num_3), ZCoordinate=0)  # -> flatten(Point)
lng_3 = ListLength(List=num_3)
sqr = Square(Value=lng_3)
subtraction = Subtraction(A=sqr, B=1)
dom_2 = ConstructDomain(DomainStart=0, DomainEnd=subtraction)
random_2 = Random(Range=dom_2, Number=Slider(10000, range=0..10000), Seed=2)
division_2 = Division(A=ma_2.Result, B=lng_2)
round = Round(Number=random_2)  # -> Nearest, Floor, Ceiling
sort = SortList(Keys=random)  # -> Keys, ValuesA
subtraction_2 = Subtraction(A=merge, B=division)
subtraction_3 = Subtraction(A=merge_2, B=division_2)
sift = SiftPattern(List=sort.Keys, SiftPattern=[0, 0, 1, 1])  # -> Output0, Output1
dom_3 = ConstructDomain(DomainStart=sift.Output0, DomainEnd=sift.Output1)
item = ListItem(List=pt_2, Index=round.Nearest, Wrap=True)
clean = CleanTree(RemoveNulls=True, RemoveInvalid=True, RemoveEmpty=False)
ma_3 = MassAddition(Input=item)  # -> Result, PartialResults
duppt = RemoveDuplicatePts(Points=ma_3.PartialResults, Tolerance=0.01)
pt_3 = Point(ma_3.PartialResults)
pline = PolyLine(Vertices=duppt, Closed=False)
intcrv = Interpolate(Vertices=duppt, Degree=3, Periodic=False, KnotStyle=1)  # -> Curve, Length, Domain
