# Grasshopper definition random rectangles.gh (Grasshopper 1.0.7)

number_slider = Slider(20, range=0..100)
multiplication = Multiplication(A=number_slider, B=2)
random = Random(Range=Domain(0, 1), Number=multiplication, Seed=2)
sort = SortList(Keys=random)  # -> Keys, ValuesA
series = Series(Start=0, Step=1, Count=number_slider)
series_2 = Series(Start=0, Step=1, Count=number_slider)
sift = SiftPattern(List=sort.Keys, SiftPattern=[0, 1])  # -> Output0, Output1
series_3 = Series(Start=0, Step=1, Count=number_slider)
clean = CleanTree(RemoveNulls=True, RemoveInvalid=True, RemoveEmpty=False, Tree=sift.Output0)
clean_2 = CleanTree(RemoveNulls=True, RemoveInvalid=True, RemoveEmpty=False, Tree=sift.Output1)
graft = GraftTree(Tree=series_2, IncludeEmptyLists=True, IncludeNullItems=True)
multiplication_2 = Multiplication(A=number_slider, B=series_3)  # -> graft(Result)
multiplication_3 = Multiplication(A=number_slider, B=series_2)  # -> graft(Result)
dom = ConstructDomain(DomainStart=clean, DomainEnd=clean_2)
addition = Addition(A=flatten(multiplication_3), B=graft)
addition_2 = Addition(A=multiplication_2, B=series_3)
series_4 = Series(Start=0, Step=1, Count=number_slider)
addition_3 = Addition(A=multiplication_3, B=series_2)
item = ListItem(List=series_2, Index=addition_3, Wrap=True)  # -> flatten(Item)
multiplication_4 = Multiplication(A=number_slider, B=addition_2)  # -> graft(Result)
rectangle = Rectangle(Plane=PlaneXY(0, 0, 0), XSize=dom, YSize=dom, Radius=0)  # -> Rectangle, Length
item_2 = ListItem(List=dom, Index=addition, Wrap=True)  # -> flatten(Item)
item_3 = ListItem(List=dom, Index=item, Wrap=True)  # -> flatten(Item)
addition_4 = Addition(A=multiplication_4, B=addition_2)
rectangle_2 = Rectangle(Plane=PlaneXY(0, 0, 0), XSize=flatten(item_2), YSize=item_3, Radius=0)  # -> Rectangle, Length
